% Simulink data dictionary neck_mk3.sldd

Vcc = 48

ControlCommands = Simulink.Bus()
  Voltage: single[3], Min=-100, Max=100, Unit="%"  % Actuation voltage signals.

Measurements = Simulink.Bus()
  Encoders: single[3], Unit="deg"

ControlFeedback = Simulink.Bus()
  Encoders: single[3], Unit="deg"

Physical_MechanicalLinks = Simulink.ConnectionBus()
  Element: Connection: simmechanics.connections.geometry

MCU_Ts = 0.001
PWM_frequency = 20000

Physical_MotorPhases = Simulink.ConnectionBus()
  Motor1_Pos: Connection: foundation.electrical.electrical
  Motor1_Neg: Connection: foundation.electrical.electrical
  Motor2_Pos: Connection: foundation.electrical.electrical
  Motor2_Neg: Connection: foundation.electrical.electrical
  Motor3_Pos: Connection: foundation.electrical.electrical
  Motor3_Neg: Connection: foundation.electrical.electrical

JointReferences = Simulink.Bus()
  SetPoints: single[3], Unit="deg"  % Setpoints that the system needs to track.

Physical_Efforts = Simulink.ConnectionBus()
  Element: Connection: <domain name>

Physical_Velocities = Simulink.ConnectionBus()
  Element: Connection: <domain name>

Physical_Positions = Simulink.ConnectionBus()
  Element: Connection: <domain name>